# Grasshopper definition box.gh (Grasshopper 1.0.7)

x = GetInteger(Slider(59, range=0..100), AtLeast=1, AtMost=1, Maximum=2147483647, Minimum=-2147483648)
y = GetInteger(Slider(56, range=0..100), AtLeast=1, AtMost=1, Maximum=2147483647, Minimum=-2147483648)
z = GetInteger(Slider(58, range=0..100), AtLeast=1, AtMost=1, Maximum=2147483647, Minimum=-2147483648)
box = CenterBox(Base=PlaneXY(0, 0, 0), X=x, Y=y, Z=z)

# ---- group: RH_OUT:boxy
geo = Geometry(box)
